# Grasshopper definition 1.gh (Grasshopper 1.0.8)

map_path = FilePath("D:\zz\3\grasshopper\mapping.json")
csv_path = FilePath("D:\zz\3\grasshopper\modules.csv")
built_geo = Python3Script(x=csv_path, y=map_path)  # -> geometry, names, prices, colors
# ---------- built_geo: Python ----------
import csv
import json
import Rhino.Geometry as rg
import os

# x: modules.csv 的路径
# y: mapping.json 的路径

csv_path = x
json_path = y

# 读取 mapping.json
with open(json_path, 'r', encoding='utf-8') as f:
    mapping = json.load(f)
palette = mapping['palette']

# 初始化
geo = []
colors = []
names = []
prices = []
modules = []

# 打开 CSV（用标准库 csv.reader）
with open(csv_path, 'r', encoding='utf-8-sig') as f:
    reader = csv.DictReader(f)
    for i, row in enumerate(reader):
        cx = (i % 10) * 5
        cy = (i // 10) * 5
        pt = rg.Point3d(cx, cy, 0)

        width = float(row['width'])
        depth = float(row['depth'])
        height = float(row['height'])

        base = rg.Plane(pt, rg.Vector3d.XAxis, rg.Vector3d.YAxis)
        box = rg.Box(base, rg.Interval(0, width), rg.Interval(0, depth), rg.Interval(0, height))
        geo.append(box)

        color = palette[i % len(palette)]
        colors.append(color)
        names.append(row['name'])
        prices.append(float(row['price']))

        modules.append({
            "id": row['id'],
            "name": row['name'],
            "price": float(row['price']),
            "safe": float(row['safe']),
            "belong": float(row['belong']),
            "nature": float(row['nature']),
            "share": float(row['share']),
            "privacy": float(row['privacy']),
            "convenient": float(row['convenient']),
            "model": f"assets/glb/{row['id']}.glb",
            "thumb": f"assets/thumbs/{row['id']}.png"
        })

# 输出
a = geo       # 几何体
b = names     # 模块名称
c = prices    # 模块价格
d = colors    # 着色
# ---------- end built_geo ----------
preview = CustomPreview(Geometry=built_geo.geometry, Material=built_geo.colors)
volume = Volume(Geometry=built_geo.geometry)  # -> Volume, Centroid
tag = TextTag3D(Location=volume.Centroid, Text=built_geo.names, Size=volume.Centroid, Justification=7)
